# Grasshopper definition street decoder_WIP.gh (Grasshopper 1.0.7)

# ---- group: nodes Index
path = FilePath("D:\Desktop\IAAC\THESIS\encoding street networks\files\bearing\400\nodeIndex.txt")
file = ReadFile(File=path, PerLineParse=True)  # -> flatten(Content)

# ---- group: Edges
path_2 = FilePath("D:\Desktop\IAAC\THESIS\encoding street networks\files\bearing\400\edges.txt")
file_2 = ReadFile(File=path_2, PerLineParse=True)

# ----
split = TextSplit(Text=file_2, Separators=",")  # -> simplify(Result)
lng = ListLength(List=file)
flip = FlipMatrix(Data=split)
series = Series(Start=0, Step=1, Count=lng)
bang = ExplodeTree(Data=flip)  # -> flatten(Branch0), flatten(Branch1), flatten(Branch2), flatten(Branch3)
item = ListItem(List=series, Index=Slider(9, range=0..50), Wrap=True)
pt = Point(Point(32.84918906, 33.04300889, 0))
c_script = CSharpScript(
    start=pt,
    startindex=item,
    iterations=Slider(2, range=0..2),
    edgeStart=bang.Branch0,
    edgeEnd=bang.Branch1,
    edgeLength=bang.Branch2,
    edgeBearing=bang.Branch3,
    nodeIndex=file)  # -> out, A; inputs start: Point3d, startindex: Int32, iterations: Int32, edgeStart: list of Double, edgeEnd: list of Double, edgeLength: list of Double, edgeBearing: list of Double, nodeIndex: list of Double
# ---------- c_script: C# ----------
    //create lists for storing indicies and point geometries

    List <int> indicies = new List <int>();
    List <Point3d> points = new List <Point3d>();
    indicies.Add(startindex);
    points.Add(start);

    List <Point3d> prevpoints = new List <Point3d>();
    List <int> previndicies = new List <int>();

    // getting edge length information and endpoint indexes
    List <double> endNodes = new List <double>();
    List <double> edgeBearings = new List <double> ();
    List <double> edgeLengths = getEdgeLengths(startindex, edgeStart, nodeIndex, edgeEnd, previndicies, edgeLength, edgeBearing, ref endNodes, ref edgeBearings);

    // constructing edges of first node
    Vector3d zeroVec = new Vector3d(0, 1, 0);

    List <Line> edges = new List <Line>();

    //creating lines
    for ( int i = 0; i < edgeLengths.Count; i++){
      Line firstLine = new Line (start, zeroVec, edgeLengths[i]);
      firstLine = rotateLine(firstLine, edgeBearings[i], start);
      edges.Add(firstLine);
    }

    DataTree<Line> streets = new DataTree<Line>();
    int path = 0;
    streets.AddRange(edges, new GH_Path(path));
    //__________________________________________________________________________

    // creating list for next nodes

    List <Point3d> nextpoints = new List <Point3d>();
    List <int> nextindicies = new List <int>();


    for(int l = 0; l < endNodes.Count;l++){
      int ndindex = 0;
      for (int j = 0; j < nodeIndex.Count;j++){
        if( endNodes[l] == nodeIndex[j]){
          ndindex++;
          break;
        }
        ndindex++;
      }
      indicies.Add(ndindex);
      points.Add(new Point3d(edges[l].ToX, edges[l].ToY, 0));

      previndicies.Add(1);
      prevpoints.Add(start);


      nextindicies.Add(ndindex);
      nextpoints.Add(new Point3d(edges[l].ToX, edges[l].ToY, 0));
    }


    //__________________________________________________________________________________________________
    //next loops
    for(int k = 0; k < iterations; k++){
      List <Line> tempEdges = new List <Line>();
      List <int> tempIndicies = new List <int>();
      List <Point3d> tempPoints = new List <Point3d>();

      //loop for the nodes connected to the previous
      if( nextpoints.Count > 0){
        for( int i = 0; i < nextpoints.Count; i++){

          endNodes = new List <double>();
          edgeBearings = new List <double> ();
          List <double> edgeL = getEdgeLengths(nextindicies[i], edgeStart, nodeIndex, edgeEnd, previndicies, edgeLength, edgeBearing, ref endNodes, ref edgeBearings);

          List <int> secind = new List <int>();

          for ( int j = 0;j < endNodes.Count;j++){
            int ndindex = 0;
            for (int m = 0; m < nodeIndex.Count;m++){
              ndindex++;
              if( endNodes[j] == nodeIndex[m]){
                break;
              }

            }
            secind.Add(ndindex);
          }


          if ( endNodes.Count > 0){
            for (int j = 0; j < endNodes.Count; j++){

              
              Line l1 = new Line (nextpoints[i], zeroVec, edgeL[j]);
              l1 = rotateLine(l1, edgeBearings[j], nextpoints[i]);

              tempEdges.Add(l1);

              indicies.Add(secind[j]);
              points.Add(new Point3d(l1.ToX, l1.ToY, 0));

              tempIndicies.Add(secind[j]);
              tempPoints.Add(new Point3d(l1.ToX, l1.ToY, 0));
              
            }
          }
        }
      }

      edges = new List <Line>();
      edges.AddRange(tempEdges);

      //previndicies = new List <int>();
      previndicies.AddRange(nextindicies);

      //prevpoints = new List <Point3d>();
      prevpoints.AddRange(nextpoints);

      nextpoints = new List <Point3d>();
      nextpoints.AddRange(tempPoints);

      nextindicies = new List <int>();
      nextindicies.AddRange(tempIndicies);


      path += 1;

      streets.AddRange(tempEdges, new GH_Path(path));



    }


    A = streets;
# ---------- c_script: C# additional code ----------
  public List <double> getEdgeLengths(int ndindex, List <double> edgeStart, List <double > nodeIndex, List <double> edgeEnd, List <int> previndicies, List <double > edgeLength, List <double> edgeBearing, ref List <double> endNodes, ref List <double> edgeBearings){

    List<double> edgeLengths = new List<double>();
    int a = 0;

    for( int i = 0; i < edgeStart.Count; i++){
      if ( previndicies.Contains(a) == false){
        if (nodeIndex[ndindex] == edgeStart[i]){
          edgeLengths.Add(edgeLength[a]);
          edgeBearings.Add(360 - edgeBearing[a]);
          endNodes.Add(edgeEnd[a]);
        }
      }
      a++;
    }
    a = 0;
    for( int i = 0; i < edgeEnd.Count; i++){
      if ( previndicies.Contains(a) == false){
        if( nodeIndex[ndindex] == edgeEnd[i]){
          edgeLengths.Add(edgeLength[a]);
          edgeBearings.Add(360 - (180 + edgeBearing[a]));
          endNodes.Add(edgeStart[a]);
        }
      }
      a++;
    }

    return edgeLengths;
  }

  public Line rotateLine(Line line, double angle, Point3d ptStart){
    line.Transform(Transform.Rotation(RhinoMath.ToRadians(angle), ptStart));
    return line;
  }

  public Vector3d rotateVec(Vector3d vec, double angle, Point3d ptStart){
    vec.Transform(Transform.Rotation(RhinoMath.ToRadians(angle), ptStart));
    return vec;
  }

  public double GetRandomNumber(double minimum, double maximum)
  {
    Random random = new Random();
    return random.NextDouble() * (maximum - minimum) + minimum;
  }
# ---------- end c_script ----------
crv = Curve(c_script.A)
